# Grasshopper definition UWGWorkflow.gh (Grasshopper 1.0.5)

parkingtransitbuildings = Brep([<brep referenced from the Rhino model> x6])
# Import Urban
# Geometry
commercialbuildings = Brep([<brep referenced from the Rhino model> x13])
residentialbuildings = Brep([<brep referenced from the Rhino model> x30])
terrain = Brep(<brep referenced from the Rhino model>)
grass = Brep([<brep referenced from the Rhino model> x4])
trees = Brep([<brep referenced from the Rhino model> x178])

ladybug = Ladybug_Ladybug()  # -> Vviiiiiiiiiizzz; plug-in component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
dragonfly = Dragonfly_Dragonfly()  # -> Vviiiiiiiiiizzz; plug-in component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

# ----
# 1
toggle = BooleanToggle(True)
exportladybug = Ladybug_ExportLadybug(targetFolder="C:\Users\cmackey\Documents\GitHub\Dragonfly\newPlugin", export=Toggle(True))  # -> readMe; plug-in component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

# ----
# Visualize Urban Area
swatch = ColourSwatch(SwatchColor=RGB(82, 82, 82))
preview = CustomPreview(Geometry=terrain, Shader=swatch)
preview_2 = CustomPreview(Geometry=grass, Shader=ColourSwatch(SwatchColor=RGB(118, 168, 133)))
preview_3 = CustomPreview(Geometry=trees, Shader=ColourSwatch(SwatchColor=RGB(40, 102, 58)))
preview_4 = CustomPreview(Geometry=commercialbuildings, Shader=ColourSwatch(SwatchColor=RGB(95, 100, 178)))
preview_5 = CustomPreview(Geometry=residentialbuildings, Shader=ColourSwatch(SwatchColor=RGB(235, 206, 94)))
preview_6 = CustomPreview(Geometry=parkingtransitbuildings, Shader=ColourSwatch(SwatchColor=RGB(143, 143, 143)))

# ----
# Define Building Typologies
bldgprograms = Dragonfly_bldgPrograms({"FullServiceRestaurant", "Hospital", "LargeHotel", "LargeOffice", "MediumOffice", "MidRiseApartment", "OutPatient", "PrimarySchool", "QuickServiceRestaurant", "SecondarySchool", "SmallHotel", "SmallOffice", "StandAloneRetail", "StripMall", "SuperMarket", "Warehouse"}, selected="LargeOffice")
bldgage = Dragonfly_bldgAge({"Pre-1980's": 0, "1980's-Present": 1, "New Construction": 2}, selected="1980's-Present")
bldgprograms_2 = Dragonfly_bldgPrograms({"FullServiceRestaurant", "Hospital", "LargeHotel", "LargeOffice", "MediumOffice", "MidRiseApartment", "OutPatient", "PrimarySchool", "QuickServiceRestaurant", "SecondarySchool", "SmallHotel", "SmallOffice", "StandAloneRetail", "StripMall", "SuperMarket", "Warehouse"}, selected="MidRiseApartment")
bldgage_2 = Dragonfly_bldgAge({"Pre-1980's": 0, "1980's-Present": 1, "New Construction": 2}, selected="Pre-1980's")
bldgprograms_3 = Dragonfly_bldgPrograms({"FullServiceRestaurant", "Hospital", "LargeHotel", "LargeOffice", "MediumOffice", "MidRiseApartment", "OutPatient", "PrimarySchool", "QuickServiceRestaurant", "SecondarySchool", "SmallHotel", "SmallOffice", "StandAloneRetail", "StripMall", "SuperMarket", "Warehouse"}, selected="Warehouse")
bldgage_3 = Dragonfly_bldgAge({"Pre-1980's": 0, "1980's-Present": 1, "New Construction": 2}, selected="1980's-Present")
bldgtypology = Dragonfly_UWGBuildingTypology(bldgGeo=commercialbuildings, bldgProgram=bldgprograms, bldgAge=bldgage, floor2Floor="4", glzRatio="0.6", runIt=toggle)  # -> readMe, port, buildingTypology, port_2, bldgFootprints, bldgFloorBreps, facadeBreps; plug-in component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
bldgtypology_2 = Dragonfly_UWGBuildingTypology(bldgGeo=parkingtransitbuildings, bldgProgram=bldgprograms_3, bldgAge=bldgage_3, floor2Floor="5", runIt=toggle)  # -> readMe, port, buildingTypology, port_2, bldgFootprints, bldgFloorBreps, facadeBreps; plug-in component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
bldgtypology_3 = Dragonfly_UWGBuildingTypology(bldgGeo=residentialbuildings, bldgProgram=bldgprograms_2, bldgAge=bldgage_2, runIt=toggle)  # -> readMe, port, buildingTypology, port_2, bldgFootprints, bldgFloorBreps, facadeBreps; plug-in component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

vegpar = Dragonfly_VegetationParameters(vegetationAlbedo="0.5")  # -> vegetationPar; plug-in component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
pavementpar = Dragonfly_PavementParameters(albedo="0.25")  # -> pavementPar; plug-in component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
trafficpar = Dragonfly_TrafficParameters(sensibleHeat="10")  # -> trafficPar; plug-in component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

dragonfly_building_typologies = Panel([bldgtypology.buildingTypology, bldgtypology_3.buildingTypology, bldgtypology_2.buildingTypology])
# 2
toggle_2 = BooleanToggle(True)

# ----
# Import Climate Data
panel = Panel("http://apps1.eere.energy.gov/buildings/energyplus/weatherdata/4_north_and_central_america_wmo_region_4/1_usa/USA_FL_Miami.Intl.AP.722020_TMY3.zip")
epw_stat = Ladybug_OpenEPWAndSTATWeatherFiles(weatherFileURL=panel)  # -> epwFile, statFile; plug-in component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

importstat = Ladybug_ImportStat(statFile=epw_stat.statFile)  # -> readMe, ashraeClimateZone, koppenClimateZone, heatingDesignTemps, coolingDesignTemps, heatingDesignDay, coolingDesignDay, monthlyTauBeam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; plug-in component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
# Define the City
uwgcity = Dragonfly_UWGCity(
    buildingTypologies=flatten([bldgtypology.buildingTypology, bldgtypology_3.buildingTypology, bldgtypology_2.buildingTypology]),
    terrainBrep=flatten(terrain),
    treesOrCoverage=flatten(trees),
    grassOrCoverage=flatten(grass),
    climateZone=importstat.ashraeClimateZone,
    trafficPar=trafficpar,
    vegetationPar=vegpar,
    pavementPar=pavementpar,
    runIt=toggle_2)  # -> readMe, port, UWGCity, port_2, treeFootprints, grassFootprints, terrainSrf; plug-in component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
dragonfly_city = Panel(uwgcity.UWGCity)
# 3
toggle_3 = BooleanToggle(False)

boundarylayerpar = Dragonfly_BoundaryLayerParameters()  # -> boundLayerPar; plug-in component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
# Run the UWG
refepwpar = Dragonfly_ReferenceEPWParameters(vegetationCoverage="0.8")  # -> epwSitePar; plug-in component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
runuwg = Dragonfly_RunUrbanWeatherGenerator(epwFile=epw_stat.epwFile, UWGCity=uwgcity.UWGCity, epwSitePar=refepwpar, boundLayerPar=boundarylayerpar, runUWG=toggle_3)  # -> readMe, port, epwFileAddress, port_2, uwgObject; plug-in component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

python = GhPythonScript()  # -> out, a
# ---------- python: Python ----------
__author__ = "cmackey"
__version__ = "2018.05.26"

from UWG import UWG


epwFile = 'C:\\Users\\cmackey\\Documents\\GitHub\\urbanWeatherGen\\resources\\epw\\SGP_Singapore.486980_IWEC.epw'
paramFile = 'C:\\Users\\cmackey\\Documents\\GitHub\\urbanWeatherGen\\resources\\parameters\\initialize_singapore.uwg'
myUWG = UWG(epwFile, paramFile)
myUWG.read_input()
print myUWG.bld
# ---------- end python ----------
