# Grasshopper definition 1_UWGfromBuildingGeometries.gh (Grasshopper 1.0.5)

parkingtransitbuildings = Brep([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])
# Import Urban
# Geometry
commercialbuildings = Brep([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])
residentialbuildings = Brep([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])
terrain = Brep(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)
grass = Brep([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])
trees = Brep([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])

dragonfly = Dragonfly_Dragonfly()  # -> Vviiiiiiiiiizzz; plug-in component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
ladybug = Ladybug_Ladybug()  # -> Vviiiiiiiiiizzz; plug-in component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

# ----
# 1
toggle = BooleanToggle(True)

# ----
# Visualize Urban Area
swatch = ColourSwatch(SwatchColor=RGB(82, 82, 82))
preview = CustomPreview(Geometry=terrain, Shader=swatch)
preview_2 = CustomPreview(Geometry=grass, Shader=ColourSwatch(SwatchColor=RGB(118, 168, 133)))
preview_3 = CustomPreview(Geometry=trees, Shader=ColourSwatch(SwatchColor=RGB(40, 102, 58)))
preview_4 = CustomPreview(Geometry=commercialbuildings, Shader=ColourSwatch(SwatchColor=RGB(95, 100, 178)))
preview_5 = CustomPreview(Geometry=residentialbuildings, Shader=ColourSwatch(SwatchColor=RGB(235, 206, 94)))
preview_6 = CustomPreview(Geometry=parkingtransitbuildings, Shader=ColourSwatch(SwatchColor=RGB(143, 143, 143)))

# ----
# Define Building Typologies
bldg_program = Dragonfly_BldgProgram({"FullServiceRestaurant", "Hospital", "LargeHotel", "LargeOffice", "MediumOffice", "MidRiseApartment", "OutPatient", "PrimarySchool", "QuickServiceRestaurant", "SecondarySchool", "SmallHotel", "SmallOffice", "StandAloneRetail", "StripMall", "SuperMarket", "Warehouse"}, selected="LargeOffice")
bldg_age = Dragonfly_BldgAge({"Pre-1980's": "Pre1980s", "1980's-Present": "1980sPresent", "New Construction": "NewConstruction"}, selected="1980's-Present")
bldg_program_2 = Dragonfly_BldgProgram({"FullServiceRestaurant", "Hospital", "LargeHotel", "LargeOffice", "MediumOffice", "MidRiseApartment", "OutPatient", "PrimarySchool", "QuickServiceRestaurant", "SecondarySchool", "SmallHotel", "SmallOffice", "StandAloneRetail", "StripMall", "SuperMarket", "Warehouse"}, selected="MidRiseApartment")
bldg_age_2 = Dragonfly_BldgAge({"Pre-1980's": "Pre1980s", "1980's-Present": "1980sPresent", "New Construction": "NewConstruction"}, selected="Pre-1980's")
bldg_program_3 = Dragonfly_BldgProgram({"FullServiceRestaurant", "Hospital", "LargeHotel", "LargeOffice", "MediumOffice", "MidRiseApartment", "OutPatient", "PrimarySchool", "QuickServiceRestaurant", "SecondarySchool", "SmallHotel", "SmallOffice", "StandAloneRetail", "StripMall", "SuperMarket", "Warehouse"}, selected="Warehouse")
bldg_age_3 = Dragonfly_BldgAge({"Pre-1980's": "Pre1980s", "1980's-Present": "1980sPresent", "New Construction": "NewConstruction"}, selected="1980's-Present")
bldgtypology = Dragonfly_BuildingTypology(geo=commercialbuildings, program=bldg_program, age=bldg_age, flr_to_flr="4", glz_ratio="0.6", run=toggle)  # -> read_me, port, DF_typology, port_2, footprints, floors, facades; plug-in component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
bldgtypology_2 = Dragonfly_BuildingTypology(geo=residentialbuildings, program=bldg_program_2, age=bldg_age_2, run=toggle)  # -> read_me, port, DF_typology, port_2, footprints, floors, facades; plug-in component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
bldgtypology_3 = Dragonfly_BuildingTypology(geo=parkingtransitbuildings, program=bldg_program_3, age=bldg_age_3, flr_to_flr="4", run=toggle)  # -> read_me, port, DF_typology, port_2, footprints, floors, facades; plug-in component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

# ----
# Define Urban Parameters
panel = Panel("0.2")
pavementpar = Dragonfly_PavementParameters(albedo=panel)  # -> pavement_par; plug-in component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
vegpar = Dragonfly_VegetationParameters(albedo="0.45")  # -> vegetation_par; plug-in component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
trafficpar = Dragonfly_TrafficParameters(sensible_heat="10")  # -> traffic_par; plug-in component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

dragonfly_building_typologies = Panel([bldgtypology.DF_typology, bldgtypology_2.DF_typology, bldgtypology_3.DF_typology])
# 2
toggle_2 = BooleanToggle(False)

# ----
# Import Climate Data
weather_file = Panel("https://www.energyplus.net/weather-download/north_and_central_america_wmo_region_4/USA/FL/USA_FL_Miami.Intl.AP.722020_TMY3/all")
analysisperiod = Ladybug_AnalysisPeriod(fromMonth="7", toMonth="7")  # -> readMe, analysisPeriod; plug-in component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
epw_stat = Ladybug_OpenEPWAndSTATWeatherFiles(weatherFileURL=weather_file)  # -> epwFile, statFile; plug-in component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

importstat = Ladybug_ImportStat(statFile=epw_stat.statFile)  # -> readMe, ashraeClimateZone, koppenClimateZone, heatingDesignTemps, coolingDesignTemps, heatingDesignDay, coolingDesignDay, monthlyTauBeam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; plug-in component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
# Define the City
city = Dragonfly_City(
    DF_typologies=flatten([bldgtypology.DF_typology, bldgtypology_2.DF_typology, bldgtypology_3.DF_typology]),
    terrain=flatten(terrain),
    trees=flatten(trees),
    grass=flatten(grass),
    climate_zone=importstat.ashraeClimateZone,
    traffic_par=trafficpar,
    vegetation_par=vegpar,
    pavement_par=pavementpar,
    run=toggle_2)  # -> read_me, port, DF_city, port_2, tree_proj, grass_proj, terrain_proj; plug-in component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
dragonfly_city = Panel(city.DF_city)
exportladybug = Ladybug_ExportLadybug(targetFolder="C:\Users\chris\Documents\GitHub\Dragonfly", export=Toggle(False))  # -> readMe; plug-in component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
# 3
toggle_3 = BooleanToggle(False)

# ----
# Run the UWG
panel_2 = Panel("0.85")
bndlayerpar = Dragonfly_BoundaryLayerParameters()  # -> bnd_layer_par; plug-in component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
refepwpar = Dragonfly_ReferenceEPWParameters(veg_coverage=panel_2)  # -> epw_site_par; plug-in component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
runuwg = Dragonfly_RunUrbanWeatherGenerator(
    epwFile=epw_stat.epwFile,
    DFCity=city.DF_city,
    epwSitePar=refepwpar,
    bndLayerPar=bndlayerpar,
    analysisPeriod=analysisperiod.analysisPeriod,
    write=toggle_3,
    run=toggle_3)  # -> readMe, port, urbanEpw, port_2, uwgObject; plug-in component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

simulation_report = Panel(runuwg.readMe)

# ----
# Visualize the Results
importepw = Ladybug_ImportEpw(epwFile=epw_stat.epwFile)  # -> readMe, latitude, location, dryBulbTemperature, dewPointTemperature, relativeHumidity, windSpeed, windDirection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; plug-in component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
importepw_2 = Ladybug_ImportEpw(epwFile=runuwg.urbanEpw)  # -> readMe, latitude, location, dryBulbTemperature, dewPointTemperature, relativeHumidity, windSpeed, windDirection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; plug-in component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
selectandaveragedata = Ladybug_AverageData(annualHourlyData=importepw_2.dryBulbTemperature, analysisPeriod=importstat.extremeHotWeek)  # -> readMe, selHourlyData, averagedDaily, averagedMonthly, avrMonthlyPerHour, avrMonthlyMinPerHour, avrMonthlyMaxPerHour; plug-in component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
selectandaveragedata_2 = Ladybug_AverageData(annualHourlyData=importepw.dryBulbTemperature, analysisPeriod=importstat.extremeHotWeek)  # -> readMe, selHourlyData, averagedDaily, averagedMonthly, avrMonthlyPerHour, avrMonthlyMinPerHour, avrMonthlyMaxPerHour; plug-in component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
legendpar = Ladybug_LegendParameters(lowBound="24", highBound="35")  # -> legendPar; plug-in component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
_3dchart = Ladybug_3DChart(
    inputData=flatten([selectandaveragedata_2.selHourlyData, selectandaveragedata.selHourlyData]),
    basePoint="300,0,0",
    xScale="2",
    zScale="0",
    legendPar=legendpar)  # -> readMe, graphMesh, graphCurves, legend, legendBasePts, title, titleBasePts, dataPts, conditionalHOY; plug-in component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
