# Grasshopper definition 3_UWGfromParameters.gh (Grasshopper 1.0.5)

ladybug = Ladybug_Ladybug()  # -> Vviiiiiiiiiizzz; plug-in component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
dragonfly = Dragonfly_Dragonfly()  # -> Vviiiiiiiiiizzz; plug-in component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

# ----
# Import Climate Data
weather_file = Panel("https://www.energyplus.net/weather-download/north_and_central_america_wmo_region_4/USA/FL/USA_FL_Miami.Intl.AP.722020_TMY3/all")
epw_stat = Ladybug_OpenEPWAndSTATWeatherFiles(weatherFileURL=weather_file)  # -> epwFile, statFile; plug-in component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

importstat = Ladybug_ImportStat(statFile=epw_stat.statFile)  # -> readMe, ashraeClimateZone, koppenClimateZone, heatingDesignTemps, coolingDesignTemps, heatingDesignDay, coolingDesignDay, monthlyTauBeam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; plug-in component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

# ----
# Define Urban Parameters
panel = Panel("0.2")
vegpar = Dragonfly_VegetationParameters(vegetationAlbedo="0.45")  # -> vegetationPar; plug-in component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
pavementpar = Dragonfly_PavementParameters(albedo=panel)  # -> pavementPar; plug-in component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
trafficpar = Dragonfly_TrafficParameters(sensibleHeat="10")  # -> trafficPar; plug-in component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

# ---- group: Building Typologies
bldgprograms = Dragonfly_bldgPrograms({"FullServiceRestaurant", "Hospital", "LargeHotel", "LargeOffice", "MediumOffice", "MidRiseApartment", "OutPatient", "PrimarySchool", "QuickServiceRestaurant", "SecondarySchool", "SmallHotel", "SmallOffice", "StandAloneRetail", "StripMall", "SuperMarket", "Warehouse"}, selected="LargeOffice")
bldgprograms_2 = Dragonfly_bldgPrograms({"FullServiceRestaurant", "Hospital", "LargeHotel", "LargeOffice", "MediumOffice", "MidRiseApartment", "OutPatient", "PrimarySchool", "QuickServiceRestaurant", "SecondarySchool", "SmallHotel", "SmallOffice", "StandAloneRetail", "StripMall", "SuperMarket", "Warehouse"}, selected="MidRiseApartment")
bldgage = Dragonfly_bldgAge({"Pre-1980's": 0, "1980's-Present": 1, "New Construction": 2}, selected="New Construction")
bldgage_2 = Dragonfly_bldgAge({"Pre-1980's": 0, "1980's-Present": 1, "New Construction": 2}, selected="New Construction")
panel_2 = Panel("""0.4
0.6""")

# ----
# 1
toggle = BooleanToggle(False)

# ---- group: Geometry Params
panel_3 = Panel("2")
panel_4 = Panel("60")
panel_5 = Panel("0.5")

# ----
# Define the City
cityfrompar = Dragonfly_CityFomParameters(
    avg_height=panel_4,
    site_coverage=panel_5,
    facade_to_site=panel_3,
    bldg_programs=[bldgprograms, bldgprograms_2],
    bldg_ages=[bldgage, bldgage_2],
    bldg_ratios=panel_2,
    tree_coverage="0.2",
    grass_coverage="0.2",
    climate_zone=importstat.ashraeClimateZone,
    traffic_par=trafficpar,
    vegetation_par=vegpar,
    pavement_par=pavementpar,
    run=toggle)  # -> readMe, DF_city; plug-in component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
dragonfly_city = Panel(cityfrompar.DF_city)
# 2
toggle_2 = BooleanToggle(False)
# Run the UWG
runuwg = Dragonfly_RunUrbanWeatherGenerator(epwFile=epw_stat.epwFile, DFCity=cityfrompar.DF_city, write=toggle_2, run=toggle_2)  # -> readMe, port, urbanEpw, port_2, uwgObject; plug-in component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
simulation_report = Panel(runuwg.readMe)
